# Grasshopper definition ELEMENTOS_TUBULARES_DUAS_CURVAS.gh (Grasshopper 0.9.76)

raio = Slider(0.1, range=0..1)
numero_de_elemetos = Slider(53, range=0..200)
raio_2 = Slider(0.307, range=0..1)
curve = Curve(<curve referenced from the Rhino model>)
curve_2 = Curve(<curve referenced from the Rhino model>)
divide_curve = DivideCurve(Curve=curve, Count=numero_de_elemetos, Kinks=False)  # -> Points, Tangents, Parameters
divide_curve_2 = DivideCurve(Curve=curve_2, Count=numero_de_elemetos, Kinks=False)  # -> Points, Tangents, Parameters
line = Line(StartPoint=divide_curve.Points, EndPoint=divide_curve_2.Points)
# BAKE
pipe = Pipe(Curve=line, Radius=raio, Caps=1)
pipe_2 = Pipe(Curve=curve, Radius=raio_2, Caps=1)
pipe_3 = Pipe(Curve=curve_2, Radius=raio_2, Caps=1)
