# Grasshopper definition ELEMENTOS_TUBULARES_UMA_CURVA.gh (Grasshopper 0.9.76)

curve = Curve(<curve referenced from the Rhino model>)
divide_curve = DivideCurve(Curve=curve, Count=Slider(5, range=0..100), Kinks=False)  # -> Points, Tangents, Parameters
unit_z = UnitZ(Factor=Slider(38.25, range=0..100))
point = Point(divide_curve.Points)
move = Move(Geometry=point, Motion=unit_z)  # -> Geometry, Transform
line = Line(StartPoint=point, EndPoint=move.Geometry)
pipe = Pipe(Curve=line, Radius=Slider(0.25, range=0..100), Caps="1")
