# Grasshopper definition GUARDA-CORPO.gh (Grasshopper 0.9.76)

# ---- group: ENTRADAS
curve = Curve(<curve referenced from the Rhino model>)
raio_corrimão = Slider(0.025, range=0..0.2)
raio_proteção = Slider(0.025, range=0..0.2)
h_primeira_proteção = Slider(0.34, range=0..0.8)
fillet_proteção = Slider(0.05, range=0..0.3)
offsset = Slider(0.1, range=0..0.5)
raio_do_encaixe = Slider(0.01, range=0..0.3)
h_do_encaixe = Slider(0.1, range=0..0.3)
numero_de_proteções = Slider(3, range=0..5)
distancia_proximada_entre_os_fustes = Slider(1, range=0..5)
h_do_fuste = Slider(0.9, range=0..1.2)
h_entre_proteções = Slider(0.15, range=0..0.4)
raio_fuste = Slider(0.02, range=0..0.1)
fillet_corrimão = Slider(0.05, range=0..0.3)

# ----
offset = Offset(Curve=curve, Distance=offsset, Plane=PlaneXY(0, 0, 0), Corners=1)
unit_z = UnitZ(Factor=h_do_fuste)
unit_z_2 = UnitZ(Factor=h_do_encaixe)
subtraction = Subtraction(A=numero_de_proteções, B="1")
explode = Explode(Curve=offset, Recursive=Toggle(False))  # -> Segments, Vertices
length = Length(Curve=explode.Segments)
duplicate_data = DuplicateData(Data=h_entre_proteções, Number=subtraction, Order=True)
addition = Addition(A=unit_z, B=unit_z_2)
distâncias_das_curvas = Panel(length)
integer_division = IntegerDivision(A=length, B=distancia_proximada_entre_os_fustes)
insert_items = InsertItems(List=duplicate_data, Item=h_primeira_proteção, Indices=0, Wrap=True)
divide_curve = DivideCurve(Curve=explode.Segments, Count=integer_division, Kinks=False)  # -> Points, Tangents, Parameters
mass_addition = MassAddition(Input=insert_items)  # -> Result, PartialResults
move = Move(Geometry=offset, Motion=addition)  # -> Geometry, Transform
point = Point(divide_curve.Points)
panel = Panel(integer_division)
panel_2 = Panel(mass_addition.PartialResults)
unit_z_3 = UnitZ(Factor=mass_addition.PartialResults)
move_2 = Move(Geometry=point, Motion=unit_z)  # -> Geometry, Transform
move_3 = Move(Geometry=move_2.Geometry, Motion=unit_z_2)  # -> Geometry, Transform
line = Line(StartPoint=point, EndPoint=move_3.Geometry)
fillet_distance = FilletDistance(Curve=move.Geometry, Distance=fillet_corrimão)
move_4 = Move(Geometry=offset, Motion=unit_z_3)  # -> Geometry, Transform
line_2 = Line(StartPoint=point, EndPoint=move_2.Geometry)
fillet_distance_2 = FilletDistance(Curve=move_4.Geometry, Distance=fillet_proteção)

# ----
# BAKE FUSTE
# BAKE ENCAIXES
# BAKE CORRIMÃO
# BAKE PROTEÇÕES
pipe = Pipe(Curve=fillet_distance_2, Radius=raio_proteção, Caps=1)
pipe_2 = Pipe(Curve=line_2, Radius=raio_fuste, Caps=1)
pipe_3 = Pipe(Curve=line, Radius=raio_do_encaixe, Caps=1)
pipe_4 = Pipe(Curve=fillet_distance, Radius=raio_corrimão, Caps=1)
