# Grasshopper definition exemplo_janela.gh (Grasshopper 0.9.76)

# ---- group: Entradas
h_das_janelas = Slider(5, range=0..5)
e_caixilho = Slider(0.05, range=0..1)
numero_de_folhas = Slider(6, range=0..10)
h_caixilho = Slider(0.1, range=0..1)
curve = Curve(<curve referenced from the Rhino model>)

# ----
divide_curve = DivideCurve(Curve=curve, Count=numero_de_folhas, Kinks=False)  # -> Points, Tangents, Parameters
unit_z = UnitZ(Factor=h_das_janelas)
polyline = PolyLine(Vertices=divide_curve.Points, Closed=False)
explode = Explode(Curve=polyline, Recursive=True)  # -> Segments, Vertices
extrude = Extrude(Base=explode.Segments, Direction=unit_z)
deconstruct_brep = DeconstructBrep(Brep=extrude)  # -> Faces, Edges, Vertices
join_curves = JoinCurves(Curves=deconstruct_brep.Edges, Preserve=False)
offset_on_srf = OffsetOnSrf(Curve=flatten(join_curves), Distance=h_caixilho, Surface=extrude)
panel = Panel(join_curves)
weave = Weave(Pattern=[0, 1], Stream0=join_curves, Stream1=offset_on_srf, NullGaps=False)
panel_2 = Panel(offset_on_srf)
boundary_surfaces = BoundarySurfaces(Edges=weave)
panel_3 = Panel(weave)
boundary_surfaces_2 = BoundarySurfaces(Edges=offset_on_srf)
is_planar = IsPlanar(Surface=boundary_surfaces, Interior=True)  # -> Planar, Plane
deconstruct_plane = DeconstructPlane(Plane=is_planar.Plane)  # -> Origin, XAxis, YAxis, ZAxis
division = Division(A=e_caixilho, B="2")
unit_vector = UnitVector(Vector=deconstruct_plane.ZAxis)
panel_4 = Panel(deconstruct_plane.ZAxis)
multiplication = Multiplication(A=e_caixilho, B=deconstruct_plane.ZAxis)
multiplication_2 = Multiplication(A=division, B=unit_vector)

# ---- group: SAIDAS
# Bake Caixilhos
# Bake Paineis
move = Move(Geometry=boundary_surfaces_2, Motion=multiplication_2)  # -> Geometry, Transform
extrude_2 = Extrude(Base=boundary_surfaces, Direction=multiplication)
